# Grasshopper definition test.gh (Grasshopper 1.0.8)

mesh = Mesh()
spline = Curve()
mesh_2 = GetGeometry(mesh, AnnotationTypeFilter=3966, AtLeast=1, AtMost=1, DeleteInput=False, Filter=1074081855, TreeAccess=False)
spline_2 = GetGeometry(spline, AnnotationTypeFilter=3966, AtLeast=1, AtMost=1, DeleteInput=False, Filter=1074081855, TreeAccess=False)
divdist = DivideDistance(Curve=spline_2, Distance=Slider(2, range=0..10))  # -> Points, Tangents, Parameters
meshcp = MeshClosestPoint(Point=divdist.Points, Mesh=mesh_2)  # -> Point, Index, Parameter
meval = MeshEval(Mesh=mesh_2, Parameter=meshcp.Parameter)  # -> Point, Normal, Colour
move = Move(Geometry=meval.Point, Motion=meval.Normal)  # -> Geometry, Transform
neg = Negative(Value=meval.Normal)
line = LineSDL(Start=move.Geometry, Direction=neg, Length=Slider(4, range=0..10))
end = EndPoints(Curve=line)  # -> Start, End
intcrv = Interpolate(Vertices=end.End, Degree=3, Periodic=True, KnotStyle=1)  # -> Curve, Length, Domain
intcrv_2 = Interpolate(Vertices=end.Start, Degree=3, Periodic=True, KnotStyle=1)  # -> Curve, Length, Domain
rulesrf = RuledSurface(CurveA=intcrv_2.Curve, CurveB=intcrv.Curve)  # -> flatten(Surface)
meshes = MeshSplit(Mesh=mesh_2, Splitters=rulesrf)
schnittkurve = MeshMesh(MeshA=mesh_2, MeshB=rulesrf)

# ---- group: RH_Out:mesh
mesh_3 = Mesh(meshes)

# ----
c_bake = ContextBake(Content=meshes)
